# Grasshopper definition Rebound.gh (Grasshopper 1.0.8)
# plug-ins: Moyu

# ---- group: A · 快速开始：直接点 ▶ Run（六种砌法逐关轮换、经典模式、3 条命） A · Quick start: just click ▶ Run (the six bonds take turns by level, Classic mode, 3 lives)
# Rebound 回弹 · 打砖块（看起来是立面研究）· Brick breaker, disguised as a facade study
# 点 Facade Study 下面的 ▶ Run · Click ▶ Run under Facade Study.
# ← → / A D 或移动鼠标 控制挡板 · 空格 发球 · Paddle with arrows, A D or the mouse, Space serves
# Esc 暂停 / 继续，Shift+Esc 退出 · Home 复位视角 · Esc pause / resume, Shift+Esc quit, Home reset view
# 1 左边的键（美式键盘 `）老板键：切成研究图，再按一次回来 · Key left of 1 (` on US keyboards): boss key
# 右键游戏组件 › Language · 语言：Auto 跟随 Windows / 中文 / English · Right-click the study › Language: Auto (follows Windows), 中文 or English
facade = FacadeStudy(Mode=0, Level=1, MoyuLanguage="auto")  # -> State, Score, Level, Best, Panels, Windows, Metrics
metrics = Panel([facade.State, facade.Metrics])

# ---- group: B · 换砌法：Type −1 轮换 · 0 顺砌 · 1 通缝 · 2 英式 · 3 荷兰式 · 4 花墙 · 5 拱。Mode 1 = 3 分钟闪电，2 = 禅（不掉命） B · Pick a bond: Type −1 take turns · 0 stretcher · 1 stack · 2 English · 3 Flemish · 4 screen wall · 5 arch. Mode 1 = 3-minute Blitz, 2 = Zen (no lives lost)
type = Slider(2, range=-1..5)
courses = Slider(10, range=6..14)
bond = BrickBond(Type=type, Courses=courses)  # -> Wall, Bricks
mode = Slider(0, range=0..2)
level = Slider(1, range=1..15)
facade_2 = FacadeStudy(Wall=bond.Wall, Mode=mode, Level=level, MoyuLanguage="auto")  # -> State, Score, Level, Best, Panels, Windows, Metrics
metrics_2 = Panel([facade_2.State, facade_2.Metrics])

# ---- group: C · 自定义墙：Panels 里是一组闭合矩形（按大小分成玻璃 / 砖 / 混凝土），可以换成你在 Rhino 里画的立面分格 C · Custom wall: Panels holds closed rectangles (sorted by size into glass / brick / concrete); swap in a facade grid you drew in Rhino
panels = Curve([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])
bond_2 = BrickBond(Type=-1, Curves=panels, Courses=10)  # -> Wall, Bricks
facade_3 = FacadeStudy(Wall=bond_2.Wall, Mode=0, Level=1, MoyuLanguage="auto")  # -> State, Score, Level, Best, Panels, Windows, Metrics
metrics_3 = Panel([facade_3.State, facade_3.Metrics])
