# Grasshopper definition Serpentine.gh (Grasshopper 1.0.8)
# plug-ins: Moyu

# ---- group: A · 快速开始：直接点 ▶ Run（内置起伏地形、28 格、经典模式） A · Quick start: just click ▶ Run (built-in rolling terrain, 28 cells, Classic mode)
# Serpentine 蜿蜒 · 曲面贪吃蛇（看起来是景观流线研究）· Snake on a surface, disguised as a circulation study
# 点 Path Study 下面的 ▶ Run · Click ▶ Run under Path Study.
# ← / A 左转 · → / D 右转（以蛇头为准）· 按住 ↑ / Shift 冲刺 · C 切换镜头 · Turn left / right, hold ↑ to sprint, C camera
# Esc 暂停 / 继续，Shift+Esc 退出 · Home 复位视角 · Esc pause / resume, Shift+Esc quit, Home reset view
# 1 左边的键（美式键盘 `）老板键：切成研究图，再按一次回来 · Key left of 1 (` on US keyboards): boss key
# 右键游戏组件 › Language · 语言：Auto 跟随 Windows / 中文 / English · Right-click the study › Language: Auto (follows Windows), 中文 or English
path = PathStudy(Cells=28, Mode=0, Level=1, Slope=True, MoyuLanguage="auto")  # -> State, Score, Length, Best, Route, Metrics
metrics = Panel([path.State, path.Metrics])

# ---- group: B · 换场地：Type 0 起伏地形 · 1 环面（上下左右都能穿）· 2 圆管（绕一圈）· 3 马鞍屋面 · 4 球面。Mode 1 = 3 分钟闪电，2 = 禅（不会死） B · Other sites: Type 0 rolling terrain · 1 torus (wraps on every side) · 2 pipe (wraps around) · 3 saddle roof · 4 sphere. Mode 1 = 3-minute Blitz, 2 = Zen (no dying)
type = Slider(1, range=0..4)
seed = Slider(1, range=1..20)
site = SiteSurface(Type=type, Seed=seed)
cells = Slider(28, range=8..60)
mode = Slider(0, range=0..2)
level = Slider(1, range=1..15)
path_2 = PathStudy(Surface=site, Cells=cells, Mode=mode, Level=level, Slope=True, MoyuLanguage="auto")  # -> State, Score, Length, Best, Route, Metrics
metrics_2 = Panel([path_2.State, path_2.Metrics])

# ---- group: C · 你自己的曲面：接任意单个曲面（这里是 GH 原生 Sphere）。闭合方向会绕过去，球的两极当墙 C · Your own surface: plug in any single surface (here Grasshopper's own Sphere). Closed directions wrap around; a sphere's poles act as walls
radius = Slider(12, range=4..30)
sph = Sphere(Base=PlaneXY(0, 0, 0), Radius=radius)
path_3 = PathStudy(Surface=sph, Cells=28, Mode=0, Level=1, Slope=True, MoyuLanguage="auto")  # -> State, Score, Length, Best, Route, Metrics
metrics_3 = Panel([path_3.State, path_3.Metrics])
