# Grasshopper definition Swift.gh (Grasshopper 1.0.8)
# plug-ins: Moyu

# ---- group: B · 调参数：Exposure 0 避风 / 1 普通 / 2 迎风（越大越快越窄），Mode 1 = Zen，Opening 开口高度系数，Bay 开间系数，Seed 固定关卡（0 = 每次随机） B · Settings: Exposure 0 sheltered / 1 normal / 2 exposed (higher is faster and tighter), Mode 1 = Zen, Opening = opening height factor, Bay = bay width factor, Seed fixes the course (0 = new each time)
exposure = Slider(1, range=0..2)
mode = Slider(0, range=0..1)
opening = Slider(1, range=0.8..1.4)
bay = Slider(1, range=0.8..1.5)
seed = Slider(0, range=0..999)
grid = StoreyGrid(Exposure=exposure, Mode=mode, Opening=opening, Bay=bay, Seed=seed)  # -> Grid, Section
airflow = AirflowStudy(Grid=grid.Grid, MoyuLanguage="auto")  # -> State, Score, Best, Path, Section, Metrics
metrics = Panel([airflow.State, airflow.Metrics])

# ---- group: A · 快速开始：直接点 ▶ Run（普通风压，经典模式） A · Quick start: just click ▶ Run (normal exposure, Classic mode)
# Swift 雨燕 · 扇翅穿墙（看起来是剖面采光通风分析）· Flappy flight, disguised as a section daylight study
# 点 Airflow Study 下面的 ▶ Run · Click ▶ Run under Airflow Study.
# 空格 / ↑ / W / 鼠标左键 扇翅，穿过墙上的开口 · Space, ↑, W or left click flaps through the openings
# Esc 暂停 / 继续，Shift+Esc 退出 · Home 复位视角 · Esc pause / resume, Shift+Esc quit, Home reset view
# 1 左边的键（美式键盘 `）老板键：切成研究图，再按一次回来 · Key left of 1 (` on US keyboards): boss key
# 右键游戏组件 › Language · 语言：Auto 跟随 Windows / 中文 / English · Right-click the study › Language: Auto (follows Windows), 中文 or English
airflow_2 = AirflowStudy(MoyuLanguage="auto")  # -> State, Score, Best, Path, Section, Metrics
metrics_2 = Panel([airflow_2.State, airflow_2.Metrics])
