# Grasshopper definition Topo2D.gh (Grasshopper 1.0.8)
# plug-ins: Moyu

# ---- group: A · 悬臂梁（World XY）· 左边固定，右端荷载 · 拖 Load Y 可在运行中移动荷载 A · Cantilever (World XY) · fixed on the left, load at the right end · drag Load Y to move the load while it runs
# Moyu 2D 拓扑优化示例 · 2D topology optimisation example
# 把某组的 Run 开关拨到 True 开始（Timer 已接好），Reset 回到均匀密度；运行中可以拖滑块。
# Set a group's Run toggle to True to start (the Timer is wired), Reset starts over; drag sliders while it runs.
width = Slider(60, range=10..200)
height = Slider(30, range=10..100)
resolution = Slider(90, range=20..300)
load_y = Slider(15, range=0..30)
volume = Slider(0.4, range=0.1..0.9)
mode = Slider(0, range=0..2)
rectangle = Rectangle(Plane=PlaneXY(0, 0, 0), XSize=width, YSize=height, Radius=0)  # -> Rectangle, Length
Y = UnitY(Factor=1)
pt = ConstructPoint(XCoordinate=width, YCoordinate=load_y, ZCoordinate=0)
line = LineSDL(Start=Point(0, 0, 0), Direction=Y, Length=height)
bnd2d = Boundary2D(Boundary=rectangle.Rectangle, Resolution=resolution)  # -> Domain, PixelSize
support = Support2D(Geometry=line, FixX=True, FixY=True)
load = Load2D(Geometry=pt, Force=Vector(0, -1, 0))
run = BooleanToggle(False)
reset = Button()
solver = SIMPSolver2D(
    Domain=bnd2d.Domain,
    Loads=load,
    Supports=support,
    VolumeFraction=volume,
    Penalty=3,
    FilterRadius=2,
    MaxIterations=200,
    Steps=5,
    Run=run,
    Reset=reset)  # -> Result, Iteration, Compliance, Volume, Converged, History
trigger = Trigger(Interval=50, TimerInterval=50, Target=solver)
vis = Visualize2D(
    Result=solver.Result,
    Mode=mode,
    Threshold=0.5,
    SolidColour=RGB(25, 25, 25),
    VoidColour=RGB(240, 240, 240),
    Conditions=True)  # -> Mesh, Contour, Density
status = Panel([solver.Iteration, solver.Compliance, solver.Volume, solver.Converged])

# ---- group: B · 立面桥（World XZ，y = -60）· 顶边线荷载 + 实心桥面 + 空心洞口 + 钢材 E B · Bridge elevation (World XZ, y = -60) · line load on the top edge + solid deck + void opening + steel E
span = Slider(100, range=20..200)
height_2 = Slider(40, range=10..80)
resolution_2 = Slider(120, range=20..300)
volume_2 = Slider(0.3, range=0.1..0.9)
opening_r = Slider(9, range=1..18)
mode_2 = Slider(0, range=0..2)
subtraction = Subtraction(A=height_2, B=3)
pt_2 = ConstructPoint(XCoordinate=0, YCoordinate=-60, ZCoordinate=subtraction)
division = Division(A=span, B=2)
pt_3 = ConstructPoint(XCoordinate=0, YCoordinate=-60, ZCoordinate=0)
xz = XZPlane(Origin=pt_2)
pt_4 = ConstructPoint(XCoordinate=division, YCoordinate=-60, ZCoordinate=14)
xz_2 = XZPlane(Origin=pt_3)
rectangle_2 = Rectangle(Plane=xz_2, XSize=span, YSize=height_2, Radius=0)  # -> Rectangle, Length
rectangle_3 = Rectangle(Plane=xz, XSize=span, YSize=Domain(0, 3), Radius=0)  # -> Rectangle, Length
xz_3 = XZPlane(Origin=pt_4)
explode = Explode(Curve=rectangle_2.Rectangle, Recursive=True)  # -> Segments, Vertices
item = ListItem(List=explode.Segments, Index=2, Wrap=True)
item_2 = ListItem(List=explode.Segments, Index=0, Wrap=True)
cir = Circle(Plane=xz_3, Radius=opening_r)
Z = UnitZ(Factor=-10)
end = EndPoints(Curve=item_2)  # -> Start, End
bnd2d_2 = Boundary2D(Boundary=rectangle_2.Rectangle, Resolution=resolution_2)  # -> Domain, PixelSize
load_2 = Load2D(Geometry=item, Force=Z)
support_2 = Support2D(Geometry=end.Start, FixX=True, FixY=True)
support_3 = Support2D(Geometry=end.End, FixX=False, FixY=True)
area = Area2D(Region=rectangle_3.Rectangle, Solid=True)
area_2 = Area2D(Region=cir, Solid=False)
mat = Material2D(YoungsModulus=210000, PoissonRatio=0.3)
run_2 = BooleanToggle(False)
reset_2 = Button()
solver_2 = SIMPSolver2D(
    Domain=bnd2d_2.Domain,
    Loads=load_2,
    Supports=[support_2, support_3],
    Areas=[area, area_2],
    Material=mat,
    VolumeFraction=volume_2,
    Penalty=3,
    FilterRadius=2.5,
    MaxIterations=200,
    Steps=5,
    Run=run_2,
    Reset=reset_2)  # -> Result, Iteration, Compliance, Volume, Converged, History
trigger_2 = Trigger(Interval=50, TimerInterval=50, Target=solver_2)
vis_2 = Visualize2D(
    Result=solver_2.Result,
    Mode=mode_2,
    Threshold=0.5,
    SolidColour=RGB(25, 25, 25),
    VoidColour=RGB(240, 240, 240),
    Conditions=True)  # -> Mesh, Contour, Density
status_2 = Panel([solver_2.Iteration, solver_2.Compliance, solver_2.Volume, solver_2.Converged])

# ---- group: C · L 形支架 + 螺栓孔（World XY，x = 120…220）· 嵌套曲线 = 孔，平滑显示 C · L-shaped bracket with a bolt hole (World XY, x = 120…220) · a nested curve is a hole, smooth display
resolution_3 = Slider(80, range=20..300)
volume_3 = Slider(0.35, range=0.1..0.9)
mode_3 = Slider(2, range=0..2)
pline = PolyLine(
    Vertices=[Point(120, 0, 0), Point(160, 0, 0), Point(160, 40, 0), Point(220, 40, 0), Point(220, 100, 0), Point(120, 100, 0)],
    Closed=True)
circle = CircleCNR(Center=Point(140, 75, 0), Normal=Vector(0, 0, 1), Radius=6)
ln = Line(StartPoint=Point(120, 100, 0), EndPoint=Point(160, 100, 0))
bnd2d_3 = Boundary2D(Boundary=[pline, circle], Resolution=resolution_3)  # -> Domain, PixelSize
support_4 = Support2D(Geometry=ln, FixX=True, FixY=True)
load_3 = Load2D(Geometry=Point(220, 45, 0), Force=Vector(0, -5, 0))
run_3 = BooleanToggle(False)
reset_3 = Button()
solver_3 = SIMPSolver2D(
    Domain=bnd2d_3.Domain,
    Loads=load_3,
    Supports=support_4,
    VolumeFraction=volume_3,
    Penalty=3,
    FilterRadius=2,
    MaxIterations=200,
    Steps=5,
    Run=run_3,
    Reset=reset_3)  # -> Result, Iteration, Compliance, Volume, Converged, History
trigger_3 = Trigger(Interval=50, TimerInterval=50, Target=solver_3)
vis_3 = Visualize2D(
    Result=solver_3.Result,
    Mode=mode_3,
    Threshold=0.5,
    SolidColour=RGB(25, 25, 25),
    VoidColour=RGB(240, 240, 240),
    Conditions=True)  # -> Mesh, Contour, Density
status_3 = Panel([solver_3.Iteration, solver_3.Compliance, solver_3.Volume, solver_3.Converged])
