# Grasshopper definition Topo3D.gh (Grasshopper 1.0.8)
# plug-ins: Moyu

# ---- group: A · 3D 悬臂梁（World XY，原点）· x = 0 端面固定，自由端底边线荷载 A · 3D cantilever (World XY, origin) · end face at x = 0 fixed, line load on the free end's bottom edge
# Moyu 3D 拓扑优化示例 · 3D topology optimisation example
# 把某组的 Run 开关拨到 True 开始（Timer 已接好），Reset 回到均匀密度；Visualize 的 Mode：0 体素，1 光滑表面。
# Set a group's Run toggle to True to start, Reset starts over; Visualize Mode 0 = voxels, 1 = smooth surface.
length = Slider(40, range=10..100)
width = Slider(20, range=5..60)
height = Slider(20, range=5..60)
resolution = Slider(32, range=8..96)
volume = Slider(0.2, range=0.05..0.6)
mode = Slider(1, range=0..1)
xy = XYPlane(Origin=Point(0, 0, 0))
yz = YZPlane(Origin=Point(0, 0, 0))
pt = ConstructPoint(XCoordinate=length, YCoordinate=0, ZCoordinate=0)
pt_2 = ConstructPoint(XCoordinate=length, YCoordinate=width, ZCoordinate=0)
box = DomainBox(Base=xy, X=length, Y=width, Z=height)
rectangle = Rectangle(Plane=yz, XSize=width, YSize=height, Radius=0)  # -> Rectangle, Length
ln = Line(StartPoint=pt, EndPoint=pt_2)
boundary = BoundarySurfaces(Edges=rectangle.Rectangle)
bnd3d = Boundary3D(Boundary=box, Resolution=resolution)  # -> Domain, VoxelSize
support = Support3D(Geometry=boundary, FixX=True, FixY=True, FixZ=True)
load = Load3D(Geometry=ln, Force=Vector(0, 0, -1))
run = BooleanToggle(False)
reset = Button()
solver = SIMPSolver3D(
    Domain=bnd3d.Domain,
    Loads=load,
    Supports=support,
    VolumeFraction=volume,
    Penalty=3,
    FilterRadius=1.5,
    MaxIterations=150,
    Steps=2,
    Run=run,
    Reset=reset)  # -> Result, Iteration, Compliance, Volume, Converged, History
trigger = Trigger(Interval=50, TimerInterval=50, Target=solver)
vis = Visualize3D(Result=solver.Result, Mode=mode, Threshold=0.5, Colour=RGB(70, 110, 190), Conditions=True)  # -> Mesh, Surface, Density
status = Panel([solver.Iteration, solver.Compliance, solver.Volume, solver.Converged])

# ---- group: B · 3D 雨棚（x = 60…100）· 顶面面荷载 + 四角铰支 + 实心屋面板 + 空心通道 B · 3D canopy (x = 60…100) · surface load on the roof + four pinned corners + solid roof slab + void passage underneath
span = Slider(40, range=10..80)
height_2 = Slider(16, range=4..40)
resolution_2 = Slider(32, range=8..96)
volume_2 = Slider(0.2, range=0.05..0.6)
mode_2 = Slider(1, range=0..1)
subtraction = Subtraction(A=height_2, B=1.5)
pt_3 = ConstructPoint(XCoordinate=60, YCoordinate=0, ZCoordinate=0)
pt_4 = ConstructPoint(XCoordinate=60, YCoordinate=0, ZCoordinate=height_2)
pt_5 = ConstructPoint(XCoordinate=60, YCoordinate=0, ZCoordinate=subtraction)
pt_6 = ConstructPoint(XCoordinate=73, YCoordinate=-1, ZCoordinate=0)
xy_2 = XYPlane(Origin=pt_3)
xy_3 = XYPlane(Origin=pt_4)
xy_4 = XYPlane(Origin=pt_5)
xy_5 = XYPlane(Origin=pt_6)
box_2 = DomainBox(Base=xy_2, X=span, Y=span, Z=height_2)
rectangle_2 = Rectangle(Plane=xy_3, XSize=span, YSize=span, Radius=0)  # -> Rectangle, Length
rectangle_3 = Rectangle(Plane=xy_2, XSize=span, YSize=span, Radius=0)  # -> Rectangle, Length
box_3 = DomainBox(Base=xy_4, X=span, Y=span, Z=Domain(0, 1.5))
box_4 = DomainBox(Base=xy_5, X=Domain(0, 14), Y=Domain(0, 42), Z=Domain(0, 7))
boundary_2 = BoundarySurfaces(Edges=rectangle_2.Rectangle)
explode = Explode(Curve=rectangle_3.Rectangle, Recursive=True)  # -> Segments, Vertices
bnd3d_2 = Boundary3D(Boundary=box_2, Resolution=resolution_2)  # -> Domain, VoxelSize
load_2 = Load3D(Geometry=boundary_2, Force=Vector(0, 0, -1))
support_2 = Support3D(Geometry=explode.Vertices, FixX=True, FixY=True, FixZ=True)
area = Area3D(Region=box_3, Solid=True)
area_2 = Area3D(Region=box_4, Solid=False)
run_2 = BooleanToggle(False)
reset_2 = Button()
solver_2 = SIMPSolver3D(
    Domain=bnd3d_2.Domain,
    Loads=load_2,
    Supports=support_2,
    Areas=[area, area_2],
    VolumeFraction=volume_2,
    Penalty=3,
    FilterRadius=1.5,
    MaxIterations=150,
    Steps=2,
    Run=run_2,
    Reset=reset_2)  # -> Result, Iteration, Compliance, Volume, Converged, History
trigger_2 = Trigger(Interval=50, TimerInterval=50, Target=solver_2)
vis_2 = Visualize3D(Result=solver_2.Result, Mode=mode_2, Threshold=0.5, Colour=RGB(70, 110, 190), Conditions=True)  # -> Mesh, Surface, Density
status_2 = Panel([solver_2.Iteration, solver_2.Compliance, solver_2.Volume, solver_2.Converged])

# ---- group: C · 3D L 形支架 + 螺栓孔（x = 120…220）· 嵌套圆柱 = 孔，顶面固定，端部水平荷载 C · 3D L-shaped bracket with a bolt hole (x = 120…220) · a nested cylinder is a hole, top face fixed, horizontal load at the tip
thickness = Slider(12, range=4..30)
resolution_3 = Slider(40, range=8..96)
volume_3 = Slider(0.3, range=0.05..0.6)
mode_3 = Slider(1, range=0..1)
pline = PolyLine(
    Vertices=[Point(120, 0, 0), Point(160, 0, 0), Point(160, 40, 0), Point(220, 40, 0), Point(220, 100, 0), Point(120, 100, 0)],
    Closed=True)
Z = UnitZ(Factor=thickness)
xy_6 = XYPlane(Origin=Point(140, 75, 0))
xz = XZPlane(Origin=Point(120, 100, 0))
division = Division(A=thickness, B=2)
boundary_3 = BoundarySurfaces(Edges=pline)
cyl = Cylinder(Base=xy_6, Radius=6, Length=thickness)
rectangle_4 = Rectangle(Plane=xz, XSize=Domain(0, 40), YSize=thickness, Radius=0)  # -> Rectangle, Length
pt_7 = ConstructPoint(XCoordinate=220, YCoordinate=45, ZCoordinate=division)
extr = Extrude(Base=boundary_3, Direction=Z)
cap = CapHoles(Brep=cyl)
boundary_4 = BoundarySurfaces(Edges=rectangle_4.Rectangle)
bnd3d_3 = Boundary3D(Boundary=[extr, cap], Resolution=resolution_3)  # -> Domain, VoxelSize
support_3 = Support3D(Geometry=boundary_4, FixX=True, FixY=True, FixZ=True)
load_3 = Load3D(Geometry=pt_7, Force=Vector(0, -5, 0))
run_3 = BooleanToggle(False)
reset_3 = Button()
solver_3 = SIMPSolver3D(
    Domain=bnd3d_3.Domain,
    Loads=load_3,
    Supports=support_3,
    VolumeFraction=volume_3,
    Penalty=3,
    FilterRadius=1.5,
    MaxIterations=150,
    Steps=2,
    Run=run_3,
    Reset=reset_3)  # -> Result, Iteration, Compliance, Volume, Converged, History
trigger_3 = Trigger(Interval=50, TimerInterval=50, Target=solver_3)
vis_3 = Visualize3D(Result=solver_3.Result, Mode=mode_3, Threshold=0.5, Colour=RGB(70, 110, 190), Conditions=True)  # -> Mesh, Surface, Density
status_3 = Panel([solver_3.Iteration, solver_3.Compliance, solver_3.Volume, solver_3.Converged])
