# Grasshopper definition VoxStack.gh (Grasshopper 1.0.8)
# plug-ins: Moyu

# ---- group: A · 快速开始：直接点 ▶ Run（默认 5×5×12 井、标准 8 块、马拉松模式） A · Quick start: just click ▶ Run (5×5×12 well, the standard 8 units, Marathon mode)
# VoxStack 叠楼 · 3D 落块（看起来是体块研究）· 3D falling blocks, disguised as a massing study
# 点 Massing Study 下面的 ▶ Run，在当前 Rhino 视口里玩 · Click ▶ Run under Massing Study to play in the active viewport.
# ← ↑ ↓ → 移动 · 拖右下角 gumball 圆环或 Q E / W S / A D 旋转 · 空格 落下 · C 暂存 · Move, rotate (gumball or keys), Space drop, C hold
# Esc 暂停 / 继续，Shift+Esc 退出 · Home 复位视角 · Esc pause / resume, Shift+Esc quit, Home reset view
# 1 左边的键（美式键盘 `）老板键：切成研究图，再按一次回来 · Key left of 1 (` on US keyboards): boss key
# 右键游戏组件 › Language · 语言：Auto 跟随 Windows / 中文 / English · Right-click the study › Language: Auto (follows Windows), 中文 or English
mass = MassingStudy(Width=5, Depth=5, Height=12, Mode=0, Level=1, MoyuLanguage="auto")  # -> State, Score, Layers, Level, Best, Mass, Metrics
metrics = Panel([mass.State, mass.Metrics])

# ---- group: B · 自定义积木：Sketch 里 3 个随手画的盒子 + Pattern 文本 → Voxel Unit → Unit Library（Preset：-1 只用自定义，0 入门，1 标准，2 困难）。Mode 1 = 3 分钟闪电 B · Custom units: 3 rough boxes in Sketch + a Pattern text → Voxel Unit → Unit Library (Preset: -1 custom only, 0 easy, 1 standard, 2 hard). Mode 1 = 3-minute Blitz
sketch = Brep([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])
pattern = Panel("#.#/#.#|###")
unit = VoxelUnit(Geometry=sketch, Name="Pavilion 小亭", Colour=RGB(255, 122, 69), Weight=1)  # -> Unit, Voxels, Count, Orientations
unit_2 = VoxelUnit(Pattern=pattern, Name="Gate 门楼", Colour=RGB(76, 201, 240), Weight=1)  # -> Unit, Voxels, Count, Orientations
preset = Slider(1, range=-1..2)
lib = UnitLibrary(Units=[unit.Unit, unit_2.Unit], Preset=preset)  # -> Library, Units
mode = Slider(1, range=0..2)
width = Slider(5, range=4..10)
depth = Slider(5, range=4..10)
height = Slider(12, range=8..20)
mass_2 = MassingStudy(Library=lib.Library, Width=width, Depth=depth, Height=height, Mode=mode, Level=1, MoyuLanguage="auto")  # -> State, Score, Layers, Level, Best, Mass, Metrics
metrics_2 = Panel([mass_2.State, mass_2.Metrics])
