# Grasshopper definition Moyu3D-Test.gh (Grasshopper 1.0.8)
# plug-ins: Moyu

# ---- group: B · 3D 雨棚（x = 60…100）· 顶面面荷载 + 四角铰支 + 实心屋面板 + 空心通道
span = Slider(40, range=10..80)
height = Slider(16, range=4..40)
resolution = Slider(32, range=8..96)
volume = Slider(0.2, range=0.05..0.6)
mode = Slider(1, range=0..1)
subtraction = Subtraction(A=height, B=1.5)
construct_point = ConstructPoint(XCoordinate=60, YCoordinate=0, ZCoordinate=0)
construct_point_2 = ConstructPoint(XCoordinate=60, YCoordinate=0, ZCoordinate=height)
construct_point_3 = ConstructPoint(XCoordinate=60, YCoordinate=0, ZCoordinate=subtraction)
construct_point_4 = ConstructPoint(XCoordinate=73, YCoordinate=-1, ZCoordinate=0)
xy_plane = XYPlane(Origin=construct_point)
xy_plane_2 = XYPlane(Origin=construct_point_2)
xy_plane_3 = XYPlane(Origin=construct_point_3)
xy_plane_4 = XYPlane(Origin=construct_point_4)
rectangle = Rectangle(Plane=xy_plane_2, XSize=span, YSize=span, Radius=0)  # -> Rectangle, Length
rectangle_2 = Rectangle(Plane=xy_plane, XSize=span, YSize=span, Radius=0)  # -> Rectangle, Length
domain_box = DomainBox(Base=xy_plane, X=span, Y=span, Z=height)
domain_box_2 = DomainBox(Base=xy_plane_3, X=span, Y=span, Z=Domain(0, 1.5))
domain_box_3 = DomainBox(Base=xy_plane_4, X=Domain(0, 14), Y=Domain(0, 42), Z=Domain(0, 7))
explode = Explode(Curve=rectangle_2.Rectangle, Recursive=True)  # -> Segments, Vertices
boundary_surfaces = BoundarySurfaces(Edges=rectangle.Rectangle)
boundary_3d = Boundary3D(Boundary=domain_box, Resolution=resolution)  # -> Domain, VoxelSize
load_3d = Load3D(Geometry=boundary_surfaces, Force=Vector(0, 0, -1))
support_3d = Support3D(Geometry=explode.Vertices, FixX=True, FixY=True, FixZ=True)
area_3d = Area3D(Region=domain_box_2, Solid=True)
area_3d_2 = Area3D(Region=domain_box_3, Solid=False)
run = BooleanToggle(True)
reset = Button()
simp_solver_3d = SIMPSolver3D(
    Domain=boundary_3d.Domain,
    Loads=load_3d,
    Supports=support_3d,
    Areas=[area_3d, area_3d_2],
    VolumeFraction=volume,
    Penalty=3,
    FilterRadius=1.5,
    MaxIterations=150,
    Steps=2,
    Run=run,
    Reset=reset)  # -> Result, Iteration, Compliance, Volume, Converged, History
trigger = Trigger(Interval=10, TimerInterval=10, Target=simp_solver_3d)  # disabled
visualize_3d = Visualize3D(Result=simp_solver_3d.Result, Mode=mode, Threshold=0.5, Colour=RGB(70, 110, 190), Conditions=True)  # -> Mesh, Surface, Density
status = Panel([simp_solver_3d.Iteration, simp_solver_3d.Compliance, simp_solver_3d.Volume, simp_solver_3d.Converged])

# ---- group: C · 3D L 形支架 + 螺栓孔（x = 120…220）· 嵌套圆柱 = 孔，顶面固定，端部水平荷载
thickness = Slider(12, range=4..30)
resolution_2 = Slider(60, range=8..96)
volume_2 = Slider(0.3, range=0.05..0.6)
mode_2 = Slider(1, range=0..1)
polyline = PolyLine(
    Vertices=[Point(120, 0, 0), Point(160, 0, 0), Point(160, 40, 0), Point(220, 40, 0), Point(220, 100, 0), Point(120, 100, 0)],
    Closed=True)
unit_z = UnitZ(Factor=thickness)
xy_plane_5 = XYPlane(Origin=Point(140, 75, 0))
xz_plane = XZPlane(Origin=Point(120, 100, 0))
division = Division(A=thickness, B=2)
construct_point_5 = ConstructPoint(XCoordinate=220, YCoordinate=45, ZCoordinate=division)
cylinder = Cylinder(Base=xy_plane_5, Radius=6, Length=thickness)
rectangle_3 = Rectangle(Plane=xz_plane, XSize=Domain(0, 40), YSize=thickness, Radius=0)  # -> Rectangle, Length
boundary_surfaces_2 = BoundarySurfaces(Edges=polyline)
extrude = Extrude(Base=boundary_surfaces_2, Direction=unit_z)
boundary_surfaces_3 = BoundarySurfaces(Edges=rectangle_3.Rectangle)
cap_holes = CapHoles(Brep=cylinder)
boundary_3d_2 = Boundary3D(Boundary=[extrude, cap_holes], Resolution=resolution_2)  # -> Domain, VoxelSize
support_3d_2 = Support3D(Geometry=boundary_surfaces_3, FixX=True, FixY=True, FixZ=True)
load_3d_2 = Load3D(Geometry=construct_point_5, Force=Vector(0, -5, 0))
run_2 = BooleanToggle(True)
reset_2 = Button()
simp_solver_3d_2 = SIMPSolver3D(
    Domain=boundary_3d_2.Domain,
    Loads=load_3d_2,
    Supports=support_3d_2,
    VolumeFraction=volume_2,
    Penalty=3,
    FilterRadius=1.5,
    MaxIterations=150,
    Steps=2,
    Run=run_2,
    Reset=reset_2)  # -> Result, Iteration, Compliance, Volume, Converged, History
trigger_2 = Trigger(Interval=50, TimerInterval=50, Target=simp_solver_3d_2)
visualize_3d_2 = Visualize3D(Result=simp_solver_3d_2.Result, Mode=mode_2, Threshold=0.5, Colour=RGB(70, 110, 190), Conditions=True)  # -> Mesh, Surface, Density
status_2 = Panel([simp_solver_3d_2.Iteration, simp_solver_3d_2.Compliance, simp_solver_3d_2.Volume, simp_solver_3d_2.Converged])

# ---- group: A · 3D 悬臂梁（World XY，原点）· x = 0 端面固定，自由端底边线荷载
# Moyu 3D 测试文件
# 每组：把 Run 开关拨到 True 开始优化（Timer 已连好），按 Reset 回到均匀密度。
# Visualize 的 Mode：0 = 体素，1 = 光滑等值面。运行中可以拖滑块。
length = Slider(40, range=10..100)
width = Slider(20, range=5..60)
height_2 = Slider(20, range=5..60)
resolution_3 = Slider(32, range=8..96)
volume_3 = Slider(0.2, range=0.05..0.6)
mode_3 = Slider(1, range=0..1)
construct_point_6 = ConstructPoint(XCoordinate=length, YCoordinate=0, ZCoordinate=0)
construct_point_7 = ConstructPoint(XCoordinate=length, YCoordinate=width, ZCoordinate=0)
xy_plane_6 = XYPlane(Origin=Point(0, 0, 0))
yz_plane = YZPlane(Origin=Point(0, 0, 0))
line = Line(StartPoint=construct_point_6, EndPoint=construct_point_7)
rectangle_4 = Rectangle(Plane=yz_plane, XSize=width, YSize=height_2, Radius=0)  # -> Rectangle, Length
domain_box_4 = DomainBox(Base=xy_plane_6, X=length, Y=width, Z=height_2)
boundary_surfaces_4 = BoundarySurfaces(Edges=rectangle_4.Rectangle)
boundary_3d_3 = Boundary3D(Boundary=domain_box_4, Resolution=resolution_3)  # -> Domain, VoxelSize
support_3d_3 = Support3D(Geometry=boundary_surfaces_4, FixX=True, FixY=True, FixZ=True)
load_3d_3 = Load3D(Geometry=line, Force=Vector(0, 0, -1))
reset_3 = Button()
run_3 = BooleanToggle(True)
trigger_3 = Trigger(Interval=10, TimerInterval=10, Target=simp_solver_3d_3)
simp_solver_3d_3 = SIMPSolver3D(
    Domain=boundary_3d_3.Domain,
    Loads=load_3d_3,
    Supports=support_3d_3,
    VolumeFraction=volume_3,
    Penalty=3,
    FilterRadius=1.5,
    MaxIterations=150,
    Steps=Slider(1, range=0..1),
    Run=run_3,
    Reset=reset_3)  # -> Result, Iteration, Compliance, Volume, Converged, History
status_3 = Panel([simp_solver_3d_3.Iteration, simp_solver_3d_3.Compliance, simp_solver_3d_3.Volume, simp_solver_3d_3.Converged])
visualize_3d_3 = Visualize3D(
    Result=simp_solver_3d_3.Result,
    Mode=mode_3,
    Threshold=Slider(0.4, range=0..1),
    Colour=RGB(70, 110, 190),
    Conditions=True)  # -> Mesh, Surface, Density
