# Grasshopper definition MoyuBreakout-Test.gh (Grasshopper 1.0.8)
# plug-ins: Moyu

# ---- group: A · 快速开始：直接点 ▶ Run（六种砌法逐关轮换、经典模式、3 条命）
# Rebound 回弹 · 立面打砖块 · 测试文件
# 点 Facade Study 组件下面的 ▶ Run，就在当前 Rhino 视口里开始（GH 窗口挪开一点或放到副屏）。
# ← → / A D 或移动鼠标 控制挡板   空格 发球 / 松开粘住的球   鼠标左键 / 右键拖动 转视角
# ` 老板键：一键切成立面研究，再按一次 3-2-1 回来   Esc 暂停（Enter 重开，Shift+Esc 退出）
facade = FacadeStudy(Mode=0, Level=1)  # -> State, Score, Level, Best, Panels, Windows, Metrics
metrics = Panel([facade.State, facade.Metrics])

# ---- group: B · 换砌法：Type −1 轮换 · 0 顺砌 · 1 通缝 · 2 英式 · 3 荷兰式 · 4 花墙 · 5 拱。Mode 1 = 3 分钟闪电，2 = 禅（不掉命）
type = Slider(2, range=-1..5)
courses = Slider(10, range=6..14)
bond = BrickBond(Type=type, Courses=courses)  # -> Wall, Bricks
mode = Slider(0, range=0..2)
level = Slider(1, range=1..15)
facade_2 = FacadeStudy(Wall=bond.Wall, Mode=mode, Level=level)  # -> State, Score, Level, Best, Panels, Windows, Metrics
metrics_2 = Panel([facade_2.State, facade_2.Metrics])

# ---- group: C · 自定义墙：Panels 里是一组闭合矩形（按大小分成玻璃 / 砖 / 混凝土），可以换成你在 Rhino 里画的立面分格
panels = Curve([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])
bond_2 = BrickBond(Type=-1, Curves=panels, Courses=10)  # -> Wall, Bricks
facade_3 = FacadeStudy(Wall=bond_2.Wall, Mode=0, Level=1)  # -> State, Score, Level, Best, Panels, Windows, Metrics
metrics_3 = Panel([facade_3.State, facade_3.Metrics])
