# Grasshopper definition MoyuSnake-Test.gh (Grasshopper 1.0.8)
# plug-ins: Moyu

# ---- group: A · 快速开始：直接点 ▶ Run（内置起伏地形、28 格、经典模式）
# Serpentine 蜿蜒 · 曲面贪吃蛇 · 测试文件
# 点 Path Study 组件下面的 ▶ Run，就在当前 Rhino 视口里开始（GH 窗口挪开一点或放到副屏）。
# ← ↑ ↓ → 按屏幕方向转向   A / D 左转 / 右转   Shift 冲刺   C 切换镜头（跟随 / 自由）   鼠标左键 / 右键拖动 转视角
# ` 老板键：一键切成流线研究，再按一次 3-2-1 回来   Esc 暂停（Enter 重开，Shift+Esc 退出）
path = PathStudy(Cells=28, Mode=0, Level=1, Slope=True)  # -> State, Score, Length, Best, Route, Metrics
metrics = Panel([path.State, path.Metrics])

# ---- group: B · 换场地：Type 0 起伏地形 · 1 环面（上下左右都能穿）· 2 圆管（绕一圈）· 3 马鞍屋面 · 4 球面。Mode 1 = 3 分钟闪电，2 = 禅（不会死）
type = Slider(1, range=0..4)
seed = Slider(1, range=1..20)
site = SiteSurface(Type=type, Seed=seed)
cells = Slider(28, range=8..60)
mode = Slider(0, range=0..2)
level = Slider(1, range=1..15)
path_2 = PathStudy(Surface=site, Cells=cells, Mode=mode, Level=level, Slope=True)  # -> State, Score, Length, Best, Route, Metrics
metrics_2 = Panel([path_2.State, path_2.Metrics])

# ---- group: C · 你自己的曲面：接任意单个曲面（这里是 GH 原生 Sphere）。闭合方向会绕过去，球的两极当墙
radius = Slider(12, range=4..30)
sph = Sphere(Base=PlaneXY(0, 0, 0), Radius=radius)
path_3 = PathStudy(Surface=sph, Cells=28, Mode=0, Level=1, Slope=True)  # -> State, Score, Length, Best, Route, Metrics
metrics_3 = Panel([path_3.State, path_3.Metrics])
