# Grasshopper definition MoyuStack-Test.gh (Grasshopper 1.0.8)
# plug-ins: Moyu

# VoxStack 叠楼 · 测试文件
# 点 Massing Study 组件下面的 ▶ Run，就在当前 Rhino 视口里开始（GH 窗口挪开一点或放到副屏）。
# ← ↑ ↓ → 移动（跟着视角）   Q/E · W/S · A/D 旋转   空格 落下   Shift 加速   C 暂存   鼠标左键 / 右键拖动 转视角
# ` 老板键：一键切成体块研究，再按一次 3-2-1 回来   Esc 暂停（Enter 重开，Shift+Esc 退出）
number_slider = Slider(15, range=0..100)

# ---- group: B · 自定义积木：Sketch 里 3 个随手画的盒子 + Pattern 文本 → Voxel Unit → Unit Library（Preset：-1 只用自定义，0 入门，1 标准，2 困难）。Mode 1 = 3 分钟闪电
pattern = Panel("#.#/#.#|###")
sketch = Brep([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])
voxel_unit = VoxelUnit(Geometry=sketch, Name="Pavilion 小亭", Colour=RGB(255, 122, 69), Weight=1)  # -> Unit, Voxels, Count, Orientations
voxel_unit_2 = VoxelUnit(Pattern=pattern, Name="Gate 门楼", Colour=RGB(76, 201, 240), Weight=1)  # -> Unit, Voxels, Count, Orientations
preset = Slider(2, range=-1..2)
unit_library = UnitLibrary(Units=[voxel_unit.Unit, voxel_unit_2.Unit], Preset=preset)  # -> Library, Units
mode = Slider(1, range=0..2)
width = Slider(5, range=4..10)
depth = Slider(5, range=4..10)
height = Slider(12, range=8..20)
massing_study = MassingStudy(Library=unit_library.Library, Width=width, Depth=depth, Height=height, Mode=mode, Level=1)  # -> State, Score, Layers, Level, Best, Mass, Metrics
metrics = Panel([massing_study.State, massing_study.Metrics])

# ---- group: A · 快速开始：直接点 ▶ Run（默认 5×5×12 井、标准 8 块、马拉松模式）
massing_study_2 = MassingStudy(Width=5, Depth=5, Height=number_slider, Mode=Slider(1, range=0..10), Level=Slider(1, range=0..100))  # -> State, Score, Layers, Level, Best, Mass, Metrics
metrics_2 = Panel([massing_study_2.State, massing_study_2.Metrics])
