# Grasshopper definition MoyuSwift-Test.gh (Grasshopper 1.0.8)
# plug-ins: Moyu

# ---- group: B · 调参数：Exposure 0 避风 / 1 普通 / 2 迎风（越大越快越窄），Mode 1 = Zen，Opening 开口高度系数，Bay 开间系数，Seed 固定关卡（0 = 每次随机）
exposure = Slider(1, range=0..2)
mode = Slider(0, range=0..1)
opening = Slider(1, range=0.8..1.4)
bay = Slider(1, range=0.8..1.5)
seed = Slider(0, range=0..999)
grid = StoreyGrid(Exposure=exposure, Mode=mode, Opening=opening, Bay=bay, Seed=seed)  # -> Grid, Section
airflow = AirflowStudy(Grid=grid.Grid)  # -> State, Score, Best, Path, Section, Metrics
metrics = Panel([airflow.State, airflow.Metrics])

# ---- group: A · 快速开始：直接点 ▶ Run（普通风压，经典模式）
# Swift 雨燕 · 扇翅穿墙 · 测试文件
# 点 Airflow Study 组件下面的 ▶ Run，就在当前 Rhino 视口里开始（GH 窗口挪开一点或放到副屏）。
# 空格 / ↑ / W / 鼠标左键 扇一下翅膀，穿过每堵墙上的开口；碰墙或落地就结束（Zen 模式不结束）   右键拖动 转视角
# ` 老板键：一键切成住宅剖面的采光 + 通风分析图，再按一次 3-2-1 回来   Esc 暂停（Enter 重开，Shift+Esc 退出）
airflow_2 = AirflowStudy()  # -> State, Score, Best, Path, Section, Metrics
metrics_2 = Panel([airflow_2.State, airflow_2.Metrics])
